# Grasshopper definition Project2_V3.gh (Grasshopper 0.9.76)
# plug-ins: Python Interpreter, gHowl

circle = CircleCNR(Center="{0,0,0}", Normal=Vector(0, 0, 1), Radius="68")
divide = DivideCurve(Curve=circle, Count=8, Kinks=False)  # -> Points, Tangents, Parameters
shatter = Shatter(Curve=circle, Parameters=divide.Points)  # -> flatten(Segments)
panel = Panel(divide.Points)
panel_2 = Panel(shatter)
panel_3 = Panel("""0
1
2
4
5
6
7""")
panel_4 = Panel("""0
1
3
4
5
6
7""")
cull_i = CullIndex(List=panel, Indices=panel_3, Wrap=True)
panel_5 = Panel("""0
2
3
4
5
6
7""")
cull_i_2 = CullIndex(List=panel, Indices=panel_4, Wrap=True)
cull_i_3 = CullIndex(List=panel, Indices=panel_5, Wrap=True)
arc = Arc3Pt(PointA=cull_i, PointB=cull_i_2, PointC=cull_i_3)  # -> Arc, Plane, Radius

# ----
# Location
number_slider = Slider(-15, range=-100..100)
number_slider_2 = Slider(-85.21, range=-100..100)

X = UnitX(Factor=number_slider)
Y = UnitY(Factor=number_slider_2)
addition = Addition(A=X, B=Y)
move = Move(Geometry=arc.Arc, Motion=addition)  # -> Geometry, Transform
move_2 = Move(Geometry="{0,0,0}", Motion=addition)  # -> Geometry, Transform

# ----
# Height of Bridge
end = EndPoints(Curve=move.Geometry)  # -> Start, End
curvepoint = PointOnCurve(move.Geometry, parameter=0.465)
curvepoint_2 = PointOnCurve(move.Geometry, parameter=0.678)
curvepoint_3 = PointOnCurve(move.Geometry, parameter=0.163)
curvepoint_4 = PointOnCurve(move.Geometry, parameter=0.92)
curvepoint_5 = PointOnCurve(move.Geometry, parameter=0.148)
Z = UnitZ(Factor=Slider(5.968, range=0..10))
Z_2 = UnitZ(Factor=Slider(6.912, range=0..10))
Z_3 = UnitZ(Factor=Slider(5.431, range=0..10))
Z_4 = UnitZ(Factor=Slider(4.086, range=0..10))
Z_5 = UnitZ(Factor=Slider(1.956, range=0..10))
move_3 = Move(Geometry=curvepoint_3, Motion=Z)  # -> Geometry, Transform
move_4 = Move(Geometry=curvepoint, Motion=Z_2)  # -> Geometry, Transform
move_5 = Move(Geometry=curvepoint_5, Motion=Z_3)  # -> Geometry, Transform
move_6 = Move(Geometry=curvepoint_2, Motion=Z_4)  # -> Geometry, Transform
move_7 = Move(Geometry=curvepoint_4, Motion=Z_5)  # -> Geometry, Transform

# ----
# Width of Bridge
number_slider_3 = Slider(0.95, range=0..1)

panel_6 = Panel([end.Start, move_5.Geometry, move_3.Geometry, move_4.Geometry, move_6.Geometry, move_7.Geometry, end.End])
netsource = NetworkSource()  # -> NetworkAdapterIsUp, AdapterProperties, LocalIpAddress
intcrv = Interpolate(Vertices=panel_6, Degree=3, Periodic=False, KnotStyle=1)  # -> Curve, Length, Domain
scale = Scale(Geometry=intcrv.Curve, Center=move_2.Geometry, Factor=number_slider_3)  # -> Geometry, Transform

# ----
# Thickness of Bridge Slab1
# Angle of Bridge Slab
# Thickness of Bridge Slab2
number_slider_4 = Slider(0.024, range=0..0.05)
expression = Expression(x=number_slider_3, y=number_slider_4, Expression="(1-x)/2+x+y")
expression_2 = Expression(x=number_slider_3, y=number_slider_4, Expression="(1-x)/2+x-y")
scale_2 = Scale(Geometry=intcrv.Curve, Center=move_2.Geometry, Factor=[expression, expression_2])  # -> Geometry, Transform
Z_6 = UnitZ(Factor=Slider(-0.3, range=-0.3..0))
Z_7 = UnitZ(Factor=Slider(-0.2, range=-2..0))
move_8 = Move(Geometry=scale_2.Geometry, Motion=Z_6)  # -> Geometry, Transform
move_9 = Move(Geometry=intcrv.Curve, Motion=Z_7)  # -> Geometry, Transform
move_10 = Move(Geometry=scale.Geometry, Motion=Z_7)  # -> Geometry, Transform
item = ListItem(List=move_8.Geometry, Index=1, Wrap=True)
item_2 = ListItem(List=move_8.Geometry, Index=0, Wrap=True)
loft = Loft(
    Curves=[item, move_10.Geometry],
    Options={Adjust=False, Closed=False, LoftEnds=0, LoftSimp=0, LoftType=0, Rebuild=10, Refit=0.01})
loft_2 = Loft(Curves=move_8.Geometry, Options={Adjust=False, Closed=False, LoftEnds=0, LoftSimp=0, LoftType=0, Rebuild=10, Refit=0.01})
loft_3 = Loft(
    Curves=[move_9.Geometry, item_2],
    Options={Adjust=False, Closed=False, LoftEnds=0, LoftSimp=0, LoftType=0, Rebuild=10, Refit=0.01})
loft_4 = Loft(
    Curves=[scale.Geometry, move_10.Geometry],
    Options={Adjust=False, Closed=False, LoftEnds=0, LoftSimp=0, LoftType=0, Rebuild=10, Refit=0.01})
loft_5 = Loft(
    Curves=[intcrv.Curve, scale.Geometry],
    Options={Adjust=False, Closed=False, LoftEnds=0, LoftSimp=0, LoftType=0, Rebuild=10, Refit=0.01})
loft_6 = Loft(
    Curves=[intcrv.Curve, move_9.Geometry],
    Options={Adjust=False, Closed=False, LoftEnds=0, LoftSimp=0, LoftType=0, Rebuild=10, Refit=0.01})

panel_7 = Panel(netsource.AdapterProperties)
udp = UDPReceiver(Address=netsource.LocalIpAddress, Port="8000", Pattern="999")  # -> Info, Data
osc_d = OSCDispatch(OSCDevices=udp.Info, OSCMessage=udp.Data)  # -> OSCDevice, OSCData
panel_8 = Panel(udp.Info)
panel_9 = Panel(udp.Data)
number_slider_5 = Slider(24.398, range=10..30)
panel_10 = Panel(osc_d.OSCDevice)
panel_11 = Panel(osc_d.OSCData)
divide_2 = DivideCurve(Curve=scale.Geometry, Count=number_slider_5, Kinks=False)  # -> Points, Tangents, Parameters
panel_12 = Panel(panel_9)
lng = ListLength(List=divide_2.Points)
curvepoint_6 = PointOnCurve(scale.Geometry, parameter=0.479)
expression_3 = Expression(x=lng, Expression="x/2")
timer = Timer(TimerInterval=500, Target=rec)

# ----
# Angle of Handrails
number_slider_6 = Slider(6.42, range=0..10)
expression_4 = Expression(x=number_slider_3, Expression="(1-x)/2+x")
scale_3 = Scale(Geometry=intcrv.Curve, Center=move_2.Geometry, Factor=expression_4)  # -> Geometry, Transform
Z_8 = UnitZ(Factor=number_slider_6)
move_11 = Move(Geometry=scale_3.Geometry, Motion=Z_8)  # -> Geometry, Transform

rec = DataRecorder(panel_12, DataLimit=-10, RecordData=True)
item_3 = ListItem(List=panel_9, Index=0, Wrap=True)  # disabled
item_4 = ListItem(List=panel_9, Index=1, Wrap=True)  # disabled
item_5 = ListItem(List=panel_9, Index=2, Wrap=True)  # disabled
path_mapper = PathMapper(rec, source="{A}(n)", target="{n\3}")
divide_3 = DivideCurve(Curve=intcrv.Curve, Count=number_slider_5, Kinks=False)  # -> Points, Tangents, Parameters
split = SplitList(List=divide_2.Points, Index=expression_3)  # -> ListA, ListB
panel_13 = Panel(path_mapper)
python = PythonScript(n=item_3)  # -> n
# ---------- python: Python ----------
if n=='/1/multixy1/1':
    n= True
else:
    n= False
print n
# ---------- end python ----------
python_2 = PythonScript(n=item_3)  # -> n
# ---------- python_2: Python ----------
if n=='/1/multixy1/2':
    n= True
else:
    n= False
print n
# ---------- end python_2 ----------
python_3 = PythonScript(n=item_3)  # -> n
# ---------- python_3: Python ----------
if n=='/1/multixy1/3':
    n= True
else:
    n= False
print n
# ---------- end python_3 ----------
panel_14 = Panel(python_2)
panel_15 = Panel(python_3)
panel_16 = Panel(python)
item_6 = ListItem(List=panel_13, Index=0, Wrap=True)
md_slider = MDSlider(
    slider_value=Point(0.7020081974, 0.9341462298, 0.5),
    SliderMode=0,
    x_domain=Domain(0, 1),
    y_domain=Domain(0, 1),
    z_domain=Domain(0, 1))

crv_cp = CurveClosestPoint(Point=split.ListA, Curve=move_11.Geometry)  # -> Point, Parameter, Distance
vec2pt = Vector2Pt(PointA=split.ListA, PointB=crv_cp.Point, Unitize=True)  # -> Vector, Length
number_slider_7 = Slider(0.972, range=0..2)
number_slider_8 = Slider(0.074, range=0..0.2)
vdis = VectorDisplay(Anchor=split.ListA, Vector=vec2pt.Vector)
line = LineSDL(Start=split.ListA, Direction=vec2pt.Vector, Length=number_slider_7)
end_2 = EndPoints(Curve=line)  # -> Start, End
intcrv_2 = Interpolate(Vertices=end_2.End, Degree=3, Periodic=False, KnotStyle=1)  # -> Curve, Length, Domain

crv_cp_2 = CurveClosestPoint(Point=divide_3.Points, Curve=move_11.Geometry)  # -> Point, Parameter, Distance
vec2pt_2 = Vector2Pt(PointA=divide_3.Points, PointB=crv_cp_2.Point, Unitize=True)  # -> Vector, Length
vdis_2 = VectorDisplay(Anchor=divide_3.Points, Vector=vec2pt_2.Vector)
line_2 = LineSDL(Start=divide_3.Points, Direction=vec2pt_2.Vector, Length=number_slider_7)
end_3 = EndPoints(Curve=line_2)  # -> Start, End
intcrv_3 = Interpolate(Vertices=end_3.End, Degree=3, Periodic=False, KnotStyle=1)  # -> Curve, Length, Domain

panel_17 = Panel(item_6)

crv_cp_3 = CurveClosestPoint(Point=split.ListB, Curve=move_11.Geometry)  # -> Point, Parameter, Distance
vec2pt_3 = Vector2Pt(PointA=split.ListB, PointB=crv_cp_3.Point, Unitize=True)  # -> Vector, Length
vdis_3 = VectorDisplay(Anchor=split.ListB, Vector=vec2pt_3.Vector)
line_3 = LineSDL(Start=split.ListB, Direction=vec2pt_3.Vector, Length=number_slider_7)
end_4 = EndPoints(Curve=line_3)  # -> Start, End
intcrv_4 = Interpolate(Vertices=end_4.End, Degree=3, Periodic=False, KnotStyle=1)  # -> Curve, Length, Domain

dispatch = Dispatch(List=[item_4, item_5], DispatchPattern=panel_16)  # -> ListA, ListB
dispatch_2 = Dispatch(List=[item_4, item_5], DispatchPattern=panel_14)  # -> ListA, ListB
dispatch_3 = Dispatch(List=[item_4, item_5], DispatchPattern=panel_15)  # -> ListA, ListB
item_7 = ListItem(List=panel_13, Index="2", Wrap=True)  # -> flatten(Item)
item_8 = ListItem(List=panel_13, Index="1", Wrap=True)  # -> flatten(Item)
flatten = FlattenTree(Tree=panel_17, Path="{0}")
rec_2 = DataRecorder(dispatch_2.ListA, DataLimit=-10, RecordData=True)
rec_3 = DataRecorder(dispatch_3.ListA, DataLimit=-10, RecordData=True)
rec_4 = DataRecorder(dispatch.ListA, DataLimit=-10, RecordData=True)
multiplication = Multiplication(A=md_slider, B=Slider(-26.881, range=-50..0))
panel_18 = Panel(flatten)
pln = Plane(multiplication)

len = Length(Curve=scale.Geometry)
expression_5 = Expression(x=len, y=number_slider_5, Expression="x/y")
sph = Sphere(Base=curvepoint_6, Radius=Slider(2.206, range=1..5))
trim = TrimWithBreps(Curve=scale.Geometry, Brep=sph)  # -> Inside, Outside
flip = FlipCurve(Curve=trim.Inside)  # -> Curve, Flag
rotate = Rotate(Geometry=trim.Inside, Angle=3.141592654, Plane=pln)  # -> Geometry, Transform

item_9 = ListItem(List=line_3, Index=0, Wrap=True)
rotate_2 = Rotate(Geometry=item_9, Angle=3.141592654, Plane=pln)  # -> Geometry, Transform
item_10 = ListItem(List=reverse(line), Index=0, Wrap=True)
rotate_3 = Rotate(Geometry=item_10, Angle=3.141592654, Plane=pln)  # -> Geometry, Transform
end_5 = EndPoints(Curve=item_9)  # -> Start, End
end_6 = EndPoints(Curve=rotate_3.Geometry)  # -> Start, End
end_7 = EndPoints(Curve=rotate_2.Geometry)  # -> Start, End
end_8 = EndPoints(Curve=item_10)  # -> Start, End
curvepoint_7 = PointOnCurve(item_9, parameter=0.3333333333)
curvepoint_8 = PointOnCurve(item_9, parameter=0.6666666667)
curvepoint_9 = PointOnCurve(rotate_3.Geometry, parameter=0.3333333333)
curvepoint_10 = PointOnCurve(rotate_3.Geometry, parameter=0.6666666667)
curvepoint_11 = PointOnCurve(rotate_2.Geometry, parameter=0.3333333333)
curvepoint_12 = PointOnCurve(rotate_2.Geometry, parameter=0.6666666667)
curvepoint_13 = PointOnCurve(item_10, parameter=0.3333333333)
curvepoint_14 = PointOnCurve(item_10, parameter=0.6666666667)
ln = Line(
    StartPoint=[end_7.Start, end_7.End, curvepoint_11, curvepoint_12],
    EndPoint=[end_8.Start, end_8.End, curvepoint_13, curvepoint_14])
ln_2 = Line(
    StartPoint=[end_5.Start, end_5.End, curvepoint_7, curvepoint_8],
    EndPoint=[end_6.Start, end_6.End, curvepoint_9, curvepoint_10])

panel_19 = Panel(item_7)
panel_20 = Panel(rec_4)
crv = Curve([intcrv.Curve, scale.Geometry])
lng_2 = ListLength(List=rec_3)
lng_3 = ListLength(List=rec_2)
lng_4 = ListLength(List=rec_4)
panel_21 = Panel(item_8)
rotate_4 = Rotate(Geometry=addition, Angle=3.141592654, Plane=pln)  # -> flatten(Geometry), Transform
lng_5 = ListLength(List=panel_18)
pdecon = Deconstruct(Point=rotate_4.Geometry)  # -> XComponent, YComponent, ZComponent
expression_6 = Expression(x=lng_4, Expression="x-1")
expression_7 = Expression(x=lng_3, Expression="x-2")
expression_8 = Expression(x=lng_3, Expression="x-1")
expression_9 = Expression(x=lng_2, Expression="x-2")
expression_10 = Expression(x=lng_2, Expression="x-1")
expression_11 = Expression(x=lng_4, Expression="x-2")
python_4 = PythonScript(n=flatten(panel_18), c=lng_5, x=flatten(item_8), y=flatten(item_7))  # -> out, flatten(ax), flatten(ay), flatten(bx), flatten(by), flatten(cx), flatten(cy); inputs n: list, x: list, y: list
# ---------- python_4: Python ----------
ax=[]
ay=[]

bx=[]
by=[]

cx=[]
cy=[]
for i in range(0,c):
    print n[i]
    if n[i]=='/1/multixy1/1':
       ax.append(x[i])
       ay.append(y[i])
    if n[i]=='/1/multixy1/2':
       bx.append(x[i])
       by.append(y[i])
    if n[i]=='/1/multixy1/3':
       cx.append(x[i])
       cy.append(y[i])
# ---------- end python_4 ----------
item_11 = ListItem(List=rec_4, Index=expression_6, Wrap=True)
item_12 = ListItem(List=rec_4, Index=expression_11, Wrap=True)
item_13 = ListItem(List=rec_2, Index=expression_7, Wrap=True)
item_14 = ListItem(List=rec_2, Index=expression_8, Wrap=True)
item_15 = ListItem(List=rec_3, Index=expression_9, Wrap=True)
item_16 = ListItem(List=rec_3, Index=expression_10, Wrap=True)

number_slider_9 = Slider(-0.19, range=-0.2..-0.05)
item_17 = ListItem(List=vec2pt_2.Vector, Index=0, Wrap=True)
item_18 = ListItem(List=vec2pt_3.Vector, Index=0, Wrap=True)
item_19 = ListItem(List=vec2pt.Vector, Index=0, Wrap=True)
amp = Amplitude(Vector=item_17, Amplitude=number_slider_9)
amp_2 = Amplitude(Vector=item_19, Amplitude=number_slider_9)
amp_3 = Amplitude(Vector=item_18, Amplitude=number_slider_9)
arrlinear = LinearArray(Geometry=intcrv_2.Curve, Direction=amp_2, Count=5)  # -> flatten(Geometry), Transform
arrlinear_2 = LinearArray(Geometry=intcrv_3.Curve, Direction=amp, Count=5)  # -> flatten(Geometry), Transform
arrlinear_3 = LinearArray(Geometry=intcrv_4.Curve, Direction=amp_3, Count=5)  # -> flatten(Geometry), Transform

pt = ConstructPoint(XCoordinate=item_12, YCoordinate=item_11, ZCoordinate=0)
pt_2 = ConstructPoint(XCoordinate=item_13, YCoordinate=item_14, ZCoordinate=0)
pt_3 = ConstructPoint(XCoordinate=item_15, YCoordinate=item_16, ZCoordinate=0)

rotate_5 = Rotate(Geometry=loft_5, Angle=3.141592654, Plane=pln)  # -> flatten(Geometry), Transform
srf = Surface(loft_5)

pdecon_2 = Deconstruct(Point=pt_3)  # -> XComponent, YComponent, ZComponent
pdecon_3 = Deconstruct(Point=pt_2)  # -> XComponent, YComponent, ZComponent
pdecon_4 = Deconstruct(Point=pt)  # -> XComponent, YComponent, ZComponent
rotate_6 = Rotate(Geometry=crv, Angle=3.141592654, Plane=pln)  # -> Geometry, Transform
panel_22 = Panel(python_4.by)
panel_23 = Panel(python_4.cx)
panel_24 = Panel(python_4.cy)
panel_25 = Panel(python_4.bx)
panel_26 = Panel(python_4.ay)
panel_27 = Panel(python_4.ax)
item_20 = ListItem(List=rotate_6.Geometry, Index=1, Wrap=True)
item_21 = ListItem(List=rotate_6.Geometry, Index=0, Wrap=True)
popgeo = PopulateGeometry(Geometry=srf, Count=Slider(768, range=100..1200), Seed=1)
crv_2 = Curve(scale.Geometry)
crv_3 = Curve(intcrv.Curve)
python1 = PythonScript(x=pdecon_4.XComponent, y=pdecon_4.YComponent, px=number_slider, py=number_slider_2, R="68", s=number_slider_3)  # -> a, b
# ---------- python1: Python ----------
import math
print px;
print py;
x=float(x);
y=float(y);
px=float(px);
py=float(py);
R=float(R);
s=float(s);

r = R * (s + (1.0 - s) * y);
delta = (x - 0.5) * math.pi / 2;
a = px + r * math.sin(delta);
b = py + r * math.cos(abs(delta));
print a;
print b;
# ---------- end python1 ----------
python1_2 = PythonScript(x=pdecon_3.XComponent, y=pdecon_3.YComponent, px=number_slider, py=number_slider_2, R="68", s=number_slider_3)  # -> a, b; same code as python1
python1_3 = PythonScript(x=pdecon_2.XComponent, y=pdecon_2.YComponent, px=number_slider, py=number_slider_2, R="68", s=number_slider_3)  # -> a, b; same code as python1
pt_4 = ConstructPoint(XCoordinate=python1_2.a, YCoordinate=python1_2.b, ZCoordinate=0)
pt_5 = ConstructPoint(XCoordinate=python1_3.a, YCoordinate=python1_3.b, ZCoordinate=0)
pt_6 = ConstructPoint(XCoordinate=python1.a, YCoordinate=python1.b, ZCoordinate=0)
srf_cp = SurfaceClosestPoint(Point=pt_5, Surface=srf)  # -> Point, UVPoint, Distance
srf_cp_2 = SurfaceClosestPoint(Point=pt_4, Surface=srf)  # -> Point, UVPoint, Distance
srf_cp_3 = SurfaceClosestPoint(Point=pt_6, Surface=srf)  # -> Point, UVPoint, Distance
curvepoint_15 = PointOnCurve(item_21, parameter=0.195)
curvepoint_16 = PointOnCurve(item_21, parameter=0.214)
curvepoint_17 = PointOnCurve(item_21, parameter=0.232)
curvepoint_18 = PointOnCurve(item_21, parameter=0.246)
curvepoint_19 = PointOnCurve(item_21, parameter=0.273)
curvepoint_20 = PointOnCurve(crv_2, parameter=0.773)
curvepoint_21 = PointOnCurve(crv_2, parameter=0.762)
curvepoint_22 = PointOnCurve(crv_2, parameter=0.748)
curvepoint_23 = PointOnCurve(crv_2, parameter=0.741)
curvepoint_24 = PointOnCurve(crv_2, parameter=0.734)
curvepoint_25 = PointOnCurve(item_20, parameter=0.212)
curvepoint_26 = PointOnCurve(item_20, parameter=0.227)
curvepoint_27 = PointOnCurve(item_20, parameter=0.248)
curvepoint_28 = PointOnCurve(item_20, parameter=0.264)
curvepoint_29 = PointOnCurve(item_20, parameter=0.288)
curvepoint_30 = PointOnCurve(crv_2, parameter=0.684)
curvepoint_31 = PointOnCurve(crv_2, parameter=0.689)
curvepoint_32 = PointOnCurve(crv_2, parameter=0.695)
curvepoint_33 = PointOnCurve(crv_2, parameter=0.699)
curvepoint_34 = PointOnCurve(crv_2, parameter=0.703)
curvepoint_35 = PointOnCurve(item_20, parameter=0.192)
curvepoint_36 = PointOnCurve(item_20, parameter=0.178)
curvepoint_37 = PointOnCurve(item_20, parameter=0.167)
curvepoint_38 = PointOnCurve(item_20, parameter=0.158)
curvepoint_39 = PointOnCurve(item_20, parameter=0.145)
curvepoint_40 = PointOnCurve(crv_3, parameter=0.727)
curvepoint_41 = PointOnCurve(crv_3, parameter=0.718)
curvepoint_42 = PointOnCurve(crv_3, parameter=0.707)
curvepoint_43 = PointOnCurve(crv_3, parameter=0.698)
curvepoint_44 = PointOnCurve(crv_3, parameter=0.688)
python2 = PythonScript(x=panel_27, y=panel_26, px=pdecon.XComponent, py=pdecon.YComponent, R="68", s=number_slider_3)  # -> a, b
# ---------- python2: Python ----------
import math
print px;
print py;
x=float(x);
y=float(y);
px=float(px);
py=float(py);
R=float(R);
s=float(s);

r = R * (s + (1.0 - s) * y);
delta = (x - 0.5) * math.pi / 2;
a = px + r * math.sin(delta);
b = py - r * math.cos(abs(delta));
print a;
print b;
# ---------- end python2 ----------
python2_2 = PythonScript(x=panel_23, y=panel_24, px=pdecon.XComponent, py=pdecon.YComponent, R="68", s=number_slider_3)  # -> a, b; same code as python2
python2_3 = PythonScript(x=panel_25, y=panel_22, px=pdecon.XComponent, py=pdecon.YComponent, R="68", s=number_slider_3)  # -> a, b; same code as python2
pt_7 = Point(curvepoint_16)
pt_8 = Point(curvepoint_17)
pt_9 = Point(curvepoint_18)
pt_10 = Point(curvepoint_19)
pt_11 = Point(curvepoint_21)
pt_12 = Point(curvepoint_22)
pt_13 = Point(curvepoint_24)
pt_14 = Point(curvepoint_25)
pt_15 = Point(curvepoint_26)
pt_16 = Point(curvepoint_28)
pt_17 = Point(curvepoint_29)
pt_18 = Point(curvepoint_30)
pt_19 = Point(curvepoint_33)
pt_20 = Point(curvepoint_34)
pt_21 = Point(curvepoint_35)
pt_22 = Point(curvepoint_36)
pt_23 = Point(curvepoint_37)
pt_24 = Point(curvepoint_39)
pt_25 = Point(curvepoint_40)
pt_26 = Point(curvepoint_41)
pt_27 = Point(curvepoint_43)
pt_28 = Point(curvepoint_44)
pt_29 = Point(curvepoint_15)
pt_30 = Point(curvepoint_20)
pt_31 = Point(curvepoint_23)
pt_32 = Point(curvepoint_27)
pt_33 = Point(curvepoint_31)
pt_34 = Point(curvepoint_32)
pt_35 = Point(curvepoint_38)
pt_36 = Point(curvepoint_42)
number_slider_10 = Slider(0.25, range=0..1)

# ----
# Bicycle
number_slider_11 = Slider(0.65, range=0..1)
number_slider_12 = Slider(0.3, range=0..1)

# ----
# Walking People
cir = Circle(Plane=srf_cp_3.Point, Radius=0.1)
Z_9 = UnitZ(Factor="1.5")
line_4 = LineSDL(Start=cir, Direction=Vector(0, 0, 1), Length=1.7)
extr = Extrude(Base=cir, Direction=Z_9)
end_9 = EndPoints(Curve=line_4)  # -> Start, End
sph_2 = Sphere(Base=end_9.End, Radius=0.15)

cir_2 = Circle(Plane=srf_cp_2.Point, Radius=0.1)
Z_10 = UnitZ(Factor="1.5")
line_5 = LineSDL(Start=cir_2, Direction=Vector(0, 0, 1), Length=1.7)
extr_2 = Extrude(Base=cir_2, Direction=Z_10)
end_10 = EndPoints(Curve=line_5)  # -> Start, End
sph_3 = Sphere(Base=end_10.End, Radius=0.15)

dist = Distance(PointA=srf_cp.Point, PointB=popgeo)  # -> flatten(Distance)
sort = SortList(Keys=dist)  # -> Keys, ValuesA
lng_6 = ListLength(List=sort.Keys)
addition_2 = Addition(A=lng_6, B=-1)
item_22 = ListItem(List=sort.Keys, Index=addition_2, Wrap=True)
item_23 = ListItem(List=sort.Keys, Index=0, Wrap=True)
python_5 = PythonScript(n=dist, x=item_23, y=item_22, c=lng_6)  # -> flatten(a), b
# ---------- python_5: Python ----------
a=(n-x)/(y-x)
a=1-a
print a
# ---------- end python_5 ----------
expression_12 = Expression(x=python_5.a, y=Slider(20, range=2..20), Expression="x^y/3")

cir_3 = Circle(Plane=srf_cp.Point, Radius=0.1)
Z_11 = UnitZ(Factor="1.5")
line_6 = LineSDL(Start=cir_3, Direction=Vector(0, 0, 1), Length=1.7)
extr_3 = Extrude(Base=cir_3, Direction=Z_11)
end_11 = EndPoints(Curve=line_6)  # -> Start, End
sph_4 = Sphere(Base=end_11.End, Radius=0.15)

dist_2 = Distance(PointA=srf_cp_3.Point, PointB=popgeo)  # -> flatten(Distance)
sort_2 = SortList(Keys=dist_2)  # -> Keys, ValuesA
lng_7 = ListLength(List=sort_2.Keys)
addition_3 = Addition(A=lng_7, B=-1)
item_24 = ListItem(List=sort_2.Keys, Index=0, Wrap=True)
item_25 = ListItem(List=sort_2.Keys, Index=addition_3, Wrap=True)
python_6 = PythonScript(n=dist_2, x=item_24, y=item_25, c=lng_7)  # -> flatten(a), b; same code as python_5
expression_13 = Expression(x=python_6.a, y=Slider(20, range=2..20), Expression="x^y/3")

dist_3 = Distance(PointA=srf_cp_2.Point, PointB=popgeo)  # -> flatten(Distance)
sort_3 = SortList(Keys=dist_3)  # -> Keys, ValuesA
lng_8 = ListLength(List=sort_3.Keys)
addition_4 = Addition(A=lng_8, B=-1)
item_26 = ListItem(List=sort_3.Keys, Index=addition_4, Wrap=True)
item_27 = ListItem(List=sort_3.Keys, Index=0, Wrap=True)
python_7 = PythonScript(n=dist_3, x=item_27, y=item_26, c=lng_8)  # -> flatten(a), b; same code as python_5
expression_14 = Expression(x=python_7.a, y=Slider(20, range=2..20), Expression="x^y/3")

ln_3 = Line(StartPoint=[pt_24, pt_21, pt_22, pt_23, pt_35], EndPoint=[pt_28, pt_25, pt_26, pt_36, pt_27])
ln_4 = Line(StartPoint=[pt_10, pt_9, pt_8, pt_7, pt_29], EndPoint=[pt_30, pt_11, pt_12, pt_31, pt_13])
ln_5 = Line(StartPoint=[pt_17, pt_14, pt_15, pt_32, pt_16], EndPoint=[pt_18, pt_20, pt_19, pt_34, pt_33])

# ----
# Strenghting Strings
# Wires
# Frame
loft_7 = Loft(
    Curves=[rotate.Geometry, flip.Curve],
    Options={Adjust=False, Closed=False, LoftEnds=0, LoftSimp=0, LoftType=0, Rebuild=10, Refit=0.01})
pipe = Pipe(Curve=[ln_2, ln], Radius=0.05, Caps=0)
pipe_2 = Pipe(Curve=[intcrv_3.Curve, line_2], Radius=number_slider_8, Caps=0)  # -> flatten(Pipe)
pipe_3 = Pipe(Curve=[intcrv_2.Curve, line], Radius=number_slider_8, Caps=0)  # -> flatten(Pipe)
pipe_4 = Pipe(Curve=[intcrv_4.Curve, line_3], Radius=number_slider_8, Caps=0)  # -> flatten(Pipe)
pipe_5 = Pipe(Curve=[arrlinear.Geometry, arrlinear_2.Geometry, arrlinear_3.Geometry], Radius=Slider(0.02, range=0.01..0.05), Caps=0)  # -> flatten(Pipe)
brep = Brep([loft_6, loft_4, loft, loft_2, loft_3])
pipe_6 = Pipe(Curve=[ln_4, ln_5, ln_3], Radius=0.05, Caps=0)  # -> flatten(Pipe)
rotate_7 = Rotate(Geometry=[pipe_5, brep, pipe_2, pipe_6, pipe_3, pipe_4], Angle=3.141592654, Plane=pln)  # -> flatten(Geometry), Transform

pt_37 = ConstructPoint(XCoordinate=python2.a, YCoordinate=python2.b, ZCoordinate=0)
srf_cp_4 = SurfaceClosestPoint(Point=pt_37, Surface=rotate_5.Geometry)  # -> Point, UVPoint, Distance

lng_9 = ListLength(List=srf_cp_4.Point)
expression_15 = Expression(x=lng_9, Expression="x-1")
expression_16 = Expression(x=lng_9, Expression="x-2")
item_28 = ListItem(List=srf_cp_4.Point, Index=expression_16, Wrap=True)
item_29 = ListItem(List=srf_cp_4.Point, Index=expression_15, Wrap=True)
Z_12 = UnitZ(Factor=number_slider_12)
vec2pt_4 = Vector2Pt(PointA=item_28, PointB=item_29, Unitize=True)  # -> Vector, Length
sph_5 = Sphere(Base=item_29, Radius=number_slider_12)
move_12 = Move(Geometry=sph_5, Motion=Z_12)  # -> Geometry, Transform
move_13 = Move(Geometry=move_12.Geometry, Motion=vec2pt_4.Vector)  # -> Geometry, Transform
debrep = DeconstructBrep(Brep=move_12.Geometry)  # -> Faces, Edges, Vertices
debrep_2 = DeconstructBrep(Brep=move_13.Geometry)  # -> Faces, Edges, Vertices
item_30 = ListItem(List=debrep_2.Vertices, Index=0, Wrap=True)
item_31 = ListItem(List=debrep_2.Vertices, Index=1, Wrap=True)
item_32 = ListItem(List=debrep.Vertices, Index=0, Wrap=True)
item_33 = ListItem(List=debrep.Vertices, Index=1, Wrap=True)
expression_17 = Expression(x=item_30, y=item_31, Expression="y+(x-y)/2")
expression_18 = Expression(x=item_32, y=item_33, Expression="y+(x-y)/2")
expression_19 = Expression(x=expression_18, y=expression_17, Expression="y+(x-y)/2")
Z_13 = UnitZ(Factor=number_slider_11)
ln_6 = Line(StartPoint=expression_18, EndPoint=expression_17)
Z_14 = UnitZ(Factor=number_slider_11)
move_14 = Move(Geometry=expression_19, Motion=Z_13)  # -> Geometry, Transform
ln_7 = Line(StartPoint=expression_17, EndPoint=move_14.Geometry)
ln_8 = Line(StartPoint=expression_18, EndPoint=move_14.Geometry)
move_15 = Move(Geometry=ln_6, Motion=Z_14)  # -> Geometry, Transform
pipe_7 = Pipe(Curve=[move_15.Geometry, ln_6, ln_7, ln_8], Radius=0.03, Caps=0)  # -> flatten(Pipe)
cap = CapHoles(Brep=pipe_7)
end_12 = EndPoints(Curve=move_15.Geometry)  # -> Start, End

pt_38 = ConstructPoint(XCoordinate=python2_3.a, YCoordinate=python2_3.b, ZCoordinate=0)
srf_cp_5 = SurfaceClosestPoint(Point=pt_38, Surface=rotate_5.Geometry)  # -> Point, UVPoint, Distance

lng_10 = ListLength(List=srf_cp_5.Point)
expression_20 = Expression(x=lng_10, Expression="x-1")
expression_21 = Expression(x=lng_10, Expression="x-2")
item_34 = ListItem(List=srf_cp_5.Point, Index=expression_21, Wrap=True)
item_35 = ListItem(List=srf_cp_5.Point, Index=expression_20, Wrap=True)
sph_6 = Sphere(Base=item_35, Radius=number_slider_12)
Z_15 = UnitZ(Factor=number_slider_12)
vec2pt_5 = Vector2Pt(PointA=item_34, PointB=item_35, Unitize=True)  # -> Vector, Length
move_16 = Move(Geometry=sph_6, Motion=Z_15)  # -> Geometry, Transform
move_17 = Move(Geometry=move_16.Geometry, Motion=vec2pt_5.Vector)  # -> Geometry, Transform
debrep_3 = DeconstructBrep(Brep=move_16.Geometry)  # -> Faces, Edges, Vertices
debrep_4 = DeconstructBrep(Brep=move_17.Geometry)  # -> Faces, Edges, Vertices
item_36 = ListItem(List=debrep_4.Vertices, Index=0, Wrap=True)
item_37 = ListItem(List=debrep_4.Vertices, Index=1, Wrap=True)
item_38 = ListItem(List=debrep_3.Vertices, Index=0, Wrap=True)
item_39 = ListItem(List=debrep_3.Vertices, Index=1, Wrap=True)
expression_22 = Expression(x=item_36, y=item_37, Expression="y+(x-y)/2")
expression_23 = Expression(x=item_38, y=item_39, Expression="y+(x-y)/2")
expression_24 = Expression(x=expression_23, y=expression_22, Expression="y+(x-y)/2")
Z_16 = UnitZ(Factor=number_slider_11)
ln_9 = Line(StartPoint=expression_23, EndPoint=expression_22)
Z_17 = UnitZ(Factor=number_slider_11)
move_18 = Move(Geometry=expression_24, Motion=Z_16)  # -> Geometry, Transform
ln_10 = Line(StartPoint=expression_22, EndPoint=move_18.Geometry)
ln_11 = Line(StartPoint=expression_23, EndPoint=move_18.Geometry)
move_19 = Move(Geometry=ln_9, Motion=Z_17)  # -> Geometry, Transform
pipe_8 = Pipe(Curve=[move_19.Geometry, ln_9, ln_10, ln_11], Radius=0.03, Caps=0)  # -> flatten(Pipe)
end_13 = EndPoints(Curve=move_19.Geometry)  # -> Start, End
sph_7 = Sphere(Base=[end_13.Start, end_13.End], Radius=0.05)

pt_39 = ConstructPoint(XCoordinate=python2_2.a, YCoordinate=python2_2.b, ZCoordinate=0)
srf_cp_6 = SurfaceClosestPoint(Point=pt_39, Surface=rotate_5.Geometry)  # -> Point, UVPoint, Distance

lng_11 = ListLength(List=srf_cp_6.Point)
expression_25 = Expression(x=lng_11, Expression="x-1")
expression_26 = Expression(x=lng_11, Expression="x-2")
item_40 = ListItem(List=srf_cp_6.Point, Index=expression_26, Wrap=True)
item_41 = ListItem(List=[srf_cp_4.Point, srf_cp_6.Point], Index=expression_25, Wrap=True)
sph_8 = Sphere(Base=item_41, Radius=number_slider_12)
Z_18 = UnitZ(Factor=number_slider_12)
vec2pt_6 = Vector2Pt(PointA=item_40, PointB=item_41, Unitize=True)  # -> Vector, Length
move_20 = Move(Geometry=sph_8, Motion=Z_18)  # -> Geometry, Transform
move_21 = Move(Geometry=move_20.Geometry, Motion=vec2pt_6.Vector)  # -> Geometry, Transform
debrep_5 = DeconstructBrep(Brep=move_20.Geometry)  # -> Faces, Edges, Vertices
debrep_6 = DeconstructBrep(Brep=move_21.Geometry)  # -> Faces, Edges, Vertices
item_42 = ListItem(List=debrep_5.Vertices, Index=0, Wrap=True)
item_43 = ListItem(List=debrep_5.Vertices, Index=1, Wrap=True)
item_44 = ListItem(List=debrep_6.Vertices, Index=0, Wrap=True)
item_45 = ListItem(List=debrep_6.Vertices, Index=1, Wrap=True)
expression_27 = Expression(x=item_44, y=item_45, Expression="y+(x-y)/2")
expression_28 = Expression(x=item_42, y=item_43, Expression="y+(x-y)/2")
expression_29 = Expression(x=expression_28, y=expression_27, Expression="y+(x-y)/2")
Z_19 = UnitZ(Factor=number_slider_11)
ln_12 = Line(StartPoint=expression_28, EndPoint=expression_27)
Z_20 = UnitZ(Factor=number_slider_11)
move_22 = Move(Geometry=expression_29, Motion=Z_19)  # -> Geometry, Transform
ln_13 = Line(StartPoint=expression_27, EndPoint=move_22.Geometry)
ln_14 = Line(StartPoint=expression_28, EndPoint=move_22.Geometry)
move_23 = Move(Geometry=ln_12, Motion=Z_20)  # -> Geometry, Transform
pipe_9 = Pipe(Curve=[move_23.Geometry, ln_12, ln_13, ln_14], Radius=0.03, Caps=0)  # -> flatten(Pipe)
end_14 = EndPoints(Curve=move_23.Geometry)  # -> Start, End
sph_9 = Sphere(Base=[end_14.Start, end_14.End], Radius=0.05)

points = PointList(Points=srf_cp_6.Point, Size=number_slider_10)
points_2 = PointList(Points=srf_cp_4.Point, Size=number_slider_10)
points_3 = PointList(Points=srf_cp_5.Point, Size=number_slider_10)
pt_40 = Point(srf_cp_5.Point)
pt_41 = Point(srf_cp_6.Point)
pt_42 = Point(srf_cp_4.Point)
addition_5 = Addition(A=expression_13, B=expression_14, C=expression_12)  # -> flatten(Result)
lng_12 = ListLength(List=pt_40)
lng_13 = ListLength(List=pt_42)
lng_14 = ListLength(List=pt_41)
max = Maximum(A=addition_5, B="0.005")
expression_30 = Expression(x=lng_12, Expression="x-1")
expression_31 = Expression(x=lng_13, Expression="x-1")
expression_32 = Expression(x=lng_14, Expression="x-1")
cir_4 = Circle(Plane=popgeo, Radius=max)
panel_28 = Panel(cir_4)
item_46 = ListItem(List=pt_41, Index=expression_32, Wrap=True)  # -> flatten(Item)
cull_i_4 = CullIndex(List=pt_41, Indices=0, Wrap=True)  # -> flatten(List)
cull_i_5 = CullIndex(List=pt_40, Indices=expression_30, Wrap=True)  # -> flatten(List)
item_47 = ListItem(List=pt_40, Index=expression_30, Wrap=True)  # -> flatten(Item)
cull_i_6 = CullIndex(List=pt_40, Indices=0, Wrap=True)  # -> flatten(List)
item_48 = ListItem(List=pt_40, Index=0, Wrap=True)  # -> flatten(Item)
item_49 = ListItem(List=pt_41, Index=0, Wrap=True)  # -> flatten(Item)
cull_i_7 = CullIndex(List=pt_42, Indices=expression_31, Wrap=True)  # -> flatten(List)
cull_i_8 = CullIndex(List=pt_42, Indices=0, Wrap=True)  # -> flatten(List)
item_50 = ListItem(List=pt_42, Index=0, Wrap=True)  # -> flatten(Item)
item_51 = ListItem(List=pt_42, Index=expression_31, Wrap=True)  # -> flatten(Item)
cull_i_9 = CullIndex(List=pt_41, Indices=expression_32, Wrap=True)  # -> flatten(List)
python_8 = PythonScript(x=panel_28)  # -> a
# ---------- python_8: Python ----------
print x;
if x == 'Circle(R:0.005 mm)':
    a=0
else:
    a=1
print a
# ---------- end python_8 ----------
panel_29 = Panel([item_46, cull_i_9])
panel_30 = Panel([item_51, cull_i_7])
panel_31 = Panel([item_47, cull_i_5])
panel_32 = Panel([cull_i_4, item_49])
panel_33 = Panel([cull_i_8, item_50])
panel_34 = Panel([cull_i_6, item_48])
panel_35 = Panel(python_8)

lng_15 = ListLength(List=pt_42)
addition_6 = Addition(A=lng_15, B=Slider(0, range=0..4))
knots = KnotVector(Count=addition_6, Degree=Slider(3, range=3..4), Periodic=Toggle(False))
intcrv_5 = Interpolate(Vertices=pt_42, Degree=3, Periodic=False, KnotStyle=1)  # -> Curve, Length, Domain

lng_16 = ListLength(List=pt_40)
addition_7 = Addition(A=lng_16, B=Slider(0, range=0..4))
intcrv_6 = Interpolate(Vertices=pt_40, Degree=3, Periodic=False, KnotStyle=1)  # -> Curve, Length, Domain
knots_2 = KnotVector(Count=addition_7, Degree=Slider(3, range=3..4), Periodic=Toggle(False))

lng_17 = ListLength(List=pt_41)
addition_8 = Addition(A=lng_17, B=Slider(0, range=0..4))
intcrv_7 = Interpolate(Vertices=pt_41, Degree=3, Periodic=False, KnotStyle=1)  # -> Curve, Length, Domain
knots_3 = KnotVector(Count=addition_8, Degree=Slider(3, range=3..4), Periodic=Toggle(False))

dist_4 = Distance(PointA=pt_40, PointB=panel_31)
dist_5 = Distance(PointA=pt_40, PointB=panel_34)
dist_6 = Distance(PointA=pt_42, PointB=panel_30)
dist_7 = Distance(PointA=pt_41, PointB=panel_29)
dist_8 = Distance(PointA=pt_42, PointB=panel_33)
dist_9 = Distance(PointA=pt_41, PointB=panel_32)
cull = CullPattern(List=addition_5, CullPattern=panel_35)
cull_2 = CullPattern(List=cir_4, CullPattern=panel_35)
panel_36 = Panel(cull)
addition_9 = Addition(A=dist_4, B=dist_5)
addition_10 = Addition(A=dist_6, B=dist_8)
addition_11 = Addition(A=dist_7, B=dist_9)
cir_5 = Circle(Plane=pt_42, Radius=Slider(0.463, range=0..1))
panel_37 = Panel(cull_2)
expression_33 = Expression(x=addition_9, Expression="x/2")
expression_34 = Expression(x=addition_10, Expression="x/2")
expression_35 = Expression(x=addition_11, Expression="x/2")
pipe_10 = Pipe(Curve=intcrv_5.Curve, Radius=0.03, Caps=0)
srf_2 = Surface(cir_5)
pipe_11 = Pipe(Curve=intcrv_7.Curve, Radius=0.03, Caps=0)
bnd = Bounds(Numbers=panel_36)
pipe_12 = Pipe(Curve=intcrv_6.Curve, Radius=0.03, Caps=0)
srf_3 = Surface(cull_2)
cir_6 = Circle(Plane=pt_42, Radius=Slider(0.463, range=0..1))
rec_5 = DataRecorder(expression_33, DataLimit=-10, RecordData=True)
rec_6 = DataRecorder(expression_35, DataLimit=-10, RecordData=True)
rec_7 = DataRecorder(expression_34, DataLimit=-10, RecordData=True)
bnd_2 = Bounds(Numbers=expression_33)
bnd_3 = Bounds(Numbers=expression_35)
bnd_4 = Bounds(Numbers=expression_34)
curvature = Curvature(Curve=intcrv_5.Curve, Parameter=knots)  # -> P, K, C
curvature_2 = Curvature(Curve=intcrv_6.Curve, Parameter=knots_2)  # -> P, K, C
curvature_3 = Curvature(Curve=intcrv_7.Curve, Parameter=intcrv_7.Curve)  # -> P, K, C
dedomain = DeconstructDomain(Domain=bnd)  # -> Start, End
dedomain_2 = DeconstructDomain(Domain=bnd_2)  # -> Start, End
dedomain_3 = DeconstructDomain(Domain=bnd_3)  # -> Start, End
dedomain_4 = DeconstructDomain(Domain=bnd_4)  # -> Start, End
srf_4 = Surface(cir_6)
bnd_5 = Bounds(Numbers=curvature.C)
bnd_6 = Bounds(Numbers=curvature_2.C)
bnd_7 = Bounds(Numbers=curvature_3.C)
num = Number(curvature.C)
gradient = Gradient(
    LowerLimit=dedomain.Start,
    UpperLimit=Slider(1.049, range=0..10),
    Parameter=cull,
    stops=[0: RGB(82, 3, 16), 0: RGB(216, 179, 209), 0: RGB(49, 193, 171), 0: RGB(57, 90, 70), 0: RGB(103, 110, 41), 0: RGB(135, 26, 13), 0: RGB(151, 166, 56), 0: RGB(9, 24, 43), 0: RGB(40, 223, 190), 0.0607: RGB(60, 200, 230)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])
dedomain_5 = DeconstructDomain(Domain=bnd_5)  # -> Start, End
dedomain_6 = DeconstructDomain(Domain=bnd_6)  # -> Start, End
dedomain_7 = DeconstructDomain(Domain=bnd_7)  # -> Start, End
gradient_2 = Gradient(
    LowerLimit=dedomain_4.Start,
    UpperLimit=dedomain_4.End,
    Parameter=expression_34,
    stops=[0: RGB(239, 75, 160), 0.004: RGB(240, 1, 114), 0.0334: RGB(240, 151, 58), 0.0589: RGB(0, 139, 139), 0.0838: RGB(66, 135, 224), 0.129: RGB(81, 63, 230), 0.196: RGB(139, 0, 139), 0.259: RGB(231, 162, 219), 0.405: RGB(178, 143, 244), 0.572: RGB(130, 192, 237)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])
gradient_3 = Gradient(
    LowerLimit=dedomain_2.Start,
    UpperLimit=dedomain_2.End,
    Parameter=expression_33,
    stops=[0.0284: RGB(231, 162, 219), 0.0792: RGB(255, 130, 160), 0.129: RGB(240, 1, 114), 0.173: RGB(192, 0, 192), 0.224: RGB(178, 143, 244), 0.276: RGB(130, 192, 237), 0.339: RGB(66, 135, 224), 0.4: RGB(81, 63, 230), 0.492: RGB(0, 139, 139), 0.566: RGB(99, 196, 128)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])
gradient_4 = Gradient(
    LowerLimit=dedomain_3.Start,
    UpperLimit=dedomain_3.End,
    Parameter=expression_35,
    stops=[0.0284: RGB(231, 162, 219), 0.0792: RGB(255, 130, 160), 0.129: RGB(240, 1, 114), 0.173: RGB(192, 0, 192), 0.224: RGB(178, 143, 244), 0.276: RGB(130, 192, 237), 0.339: RGB(66, 135, 224), 0.4: RGB(81, 63, 230), 0.492: RGB(0, 139, 139), 0.566: RGB(99, 196, 128)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])
python_9 = PythonScript(x=rec_6)  # -> flatten(x)
# ---------- python_9: Python ----------
if x < 0.01:
    x = 0;
print x
# ---------- end python_9 ----------
python_10 = PythonScript(x=rec_5)  # -> flatten(x); same code as python_9
python_11 = PythonScript(x=rec_7)  # -> flatten(x); same code as python_9
gradient_5 = Gradient(
    LowerLimit=dedomain_6.Start,
    UpperLimit=dedomain_6.End,
    Parameter=curvature_2.C,
    stops=[0: RGB(82, 3, 16), 0: RGB(9, 24, 43), 0.00359: RGB(183, 233, 228), 0.0379: RGB(131, 222, 88), 0.0738: RGB(28, 230, 57), 0.137: RGB(67, 186, 42), 0.19: RGB(7, 144, 84), 0.236: RGB(57, 90, 70), 0.263: RGB(103, 110, 41), 0.299: RGB(151, 166, 56)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])
gradient_6 = Gradient(
    LowerLimit=dedomain_7.Start,
    UpperLimit=dedomain_7.End,
    Parameter=curvature_3.C,
    stops=[0: RGB(82, 3, 16), 0: RGB(9, 24, 43), 0.00359: RGB(183, 233, 228), 0.0379: RGB(131, 222, 88), 0.0738: RGB(28, 230, 57), 0.137: RGB(67, 186, 42), 0.19: RGB(7, 144, 84), 0.236: RGB(57, 90, 70), 0.263: RGB(103, 110, 41), 0.299: RGB(151, 166, 56)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])
# Analyses 2 Curvature
gradient_7 = Gradient(
    LowerLimit=dedomain_5.Start,
    UpperLimit=dedomain_5.End,
    Parameter=curvature.C,
    stops=[0: RGB(82, 3, 16), 0: RGB(9, 24, 43), 0.00359: RGB(183, 233, 228), 0.0302: RGB(131, 222, 88), 0.0583: RGB(28, 230, 57), 0.107: RGB(67, 186, 42), 0.15: RGB(7, 144, 84), 0.196: RGB(57, 90, 70), 0.246: RGB(103, 110, 41), 0.304: RGB(151, 166, 56)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])
preview = CustomPreview(Geometry=srf_3, Shader=gradient)
points_coodinates = Panel(curvature.P)

preview_2 = CustomPreview(Geometry=pt_40, Shader=gradient_3)  # disabled
preview_3 = CustomPreview(Geometry=srf_2, Shader=gradient_2)
preview_4 = CustomPreview(Geometry=pt_41, Shader=gradient_4)

# ----
# Analyses 1 Velocity
velocity = Panel(python_11)
panel_38 = Panel(python_10)
panel_39 = Panel(python_9)

preview_5 = CustomPreview(Geometry=pt_41, Shader=gradient_6)
preview_6 = CustomPreview(Geometry=pt_40, Shader=gradient_5)
preview_7 = CustomPreview(Geometry=srf_4, Shader=gradient_7)

curvature_4 = Panel(num)
