# Grasshopper definition project1_form_physics_analyses.gh (Grasshopper 0.9.76)
# plug-ins: Kangaroo Components, LunchBox, Weaverbird

# ----
# BUILDING Variables
thickness_of_wall = Slider(0.984, range=0.8..1)
level1_scale = Slider(0.96, range=0.7..1)
level3_scale = Slider(0.872, range=0.7..1)
degree_of_curve = Slider(2, range=1..4)
height = Slider(0.779, range=0..1)
level2_scale = Slider(0.828, range=0.7..1)
level4_scale = Slider(0.787, range=0.7..1)
Z = UnitZ(Factor=height)
vec = Vector(Z)

# ----
# Base Curve
# Center Point
panel = Panel("{0,-26,0}")
panel_2 = Panel("""{8,-44,0}
{18,-42,0}
{22,-32,0}
{16,-24,0}
{2,-28,0}
{11,-12,0}
{0,2,0}
{-11,-12,0}
{-2,-28,0}
{-20,-24,0}
{-19,-36,0}
{-4,-30,0}
{-6,-34,0}""")
knots = KnotVector(Count="13", Degree=degree_of_curve, Periodic=False)
panel_3 = Panel(knots)
nurbcrv = NurbsCurve(Points=panel_2, Knots=panel_3)  # -> Curve, Length, Domain

pt = Point(panel)
crv = Curve(nurbcrv.Curve)

# ----
# PLAZA Variables
plaza_level_2 = Slider(1.143, range=1..1.3)
plaza_level_0 = Slider(1.055, range=1..1.3)
plaza_level_3 = Slider(1.233, range=1..1.3)
plaza_level_1 = Slider(1.203, range=1..1.3)

# ----
# Pipe Variables
pipe_radius = Slider(0.045, range=0.01..0.1)
distance_under_glass_window = Slider(-0.256, range=-0.5..0)

panel_4 = Panel("""479
959""")

# ----
# Dome Area of Main Building
panel_5 = Panel("""{1.292870,3,0}
{0,0,0}
{0,1,0}
{0,0,0}
{-1.292870,3,0}""")

# ----
# Dome Area of Annex Building
panel_6 = Panel("""{-4.6,1.8,0}
{-1,0,0}
{-1.5,0,0}
{-1,-1,0}
{0,2.35,0}""")

# ----
# Variables
scale = Slider(1.08, range=0.5..2)
movement = Slider(-0.357, range=-1..1)
Z_2 = UnitZ(Factor=movement)

# ----
# Variables
scale_2 = Slider(0.985, range=0.5..2)
movement_2 = Slider(-0.197, range=-1..1)
Z_3 = UnitZ(Factor=movement_2)

scale_3 = Scale(Geometry=crv, Center=pt, Factor=level1_scale)  # -> Geometry, Transform
move = Move(Geometry=scale_3.Geometry, Motion=vec)  # -> Geometry, Transform
cp = ControlPoints(Curve=move.Geometry)  # -> Points, Weights, Knots
panel_7 = Panel("""{0,0,-0.8}
{0,0,-0.6}
{0,0,-0.5}
{0,0,-0.4}""")
knots_2 = KnotVector(Count="13", Degree=degree_of_curve, Periodic=False)

panel_8 = Panel("""0
1
2
3""")
panel_9 = Panel("""4
5
6
7
8
9
10
11
12""")
cull_i = CullIndex(List=cp.Points, Indices=panel_9, Wrap=True)
cull_i_2 = CullIndex(List=cp.Points, Indices=panel_8, Wrap=True)
scale_4 = Scale(Geometry=cull_i, Center=pt, Factor=plaza_level_0)  # -> Geometry, Transform
panel_10 = Panel([scale_4.Geometry, cull_i_2])

addition = Addition(A=panel_10, B=panel_7)
nurbcrv_2 = NurbsCurve(Points=addition, Knots=knots_2)  # -> Curve, Length, Domain

loft = Loft(
    Curves=flatten([crv, nurbcrv_2.Curve]),
    Options={Adjust=False, Closed=False, LoftEnds=0, LoftSimp=0, LoftType=0, Rebuild=10, Refit=0.01})

move_2 = Move(Geometry=pt, Motion=Vector(0, 0, 10))  # -> Geometry, Transform
scale_5 = Scale(Geometry=nurbcrv_2.Curve, Center=move_2.Geometry, Factor=level2_scale)  # -> Geometry, Transform
move_3 = Move(Geometry=scale_5.Geometry, Motion=vec)  # -> Geometry, Transform
cp_2 = ControlPoints(Curve=move_3.Geometry)  # -> Points, Weights, Knots
panel_11 = Panel("""{0,0,-3.0}
{0,0,-2.8}
{0,0,-2.7}
{0,0,-2.6}
{0,0,-2.5}
{0,0,0}
{0,0,1}
{0,0,0}
{0,0,-2.5}
{0,0,0}
{0,0,0}
{0,0,-2.5}
{0,0,-2.5}""")
knots_3 = KnotVector(Count="13", Degree=degree_of_curve, Periodic=False)

panel_12 = Panel("""0
1
2
3""")
panel_13 = Panel("""4
5
6
7
8
9
10
11
12""")
cull_i_3 = CullIndex(List=cp_2.Points, Indices=panel_12, Wrap=True)
cull_i_4 = CullIndex(List=cp_2.Points, Indices=panel_13, Wrap=True)
scale_6 = Scale(Geometry=cull_i_4, Center=pt, Factor=plaza_level_1)  # -> Geometry, Transform
panel_14 = Panel([scale_6.Geometry, cull_i_3])

addition_2 = Addition(A=panel_14, B=panel_11)
nurbcrv_3 = NurbsCurve(Points=addition_2, Knots=knots_3)  # -> Curve, Length, Domain

loft_2 = Loft(
    Curves=flatten([nurbcrv_3.Curve, nurbcrv_2.Curve]),
    Options={Adjust=False, Closed=False, LoftEnds=0, LoftSimp=0, LoftType=0, Rebuild=10, Refit=0.01})

multiplication = Multiplication(A=vec, B=2)
move_4 = Move(Geometry=pt, Motion=multiplication)  # -> Geometry, Transform
scale_7 = Scale(Geometry=nurbcrv_3.Curve, Center=move_4.Geometry, Factor=level3_scale)  # -> Geometry, Transform
move_5 = Move(Geometry=scale_7.Geometry, Motion=vec)  # -> Geometry, Transform
cp_3 = ControlPoints(Curve=move_5.Geometry)  # -> Points, Weights, Knots
panel_15 = Panel("""{0,0,-1.1}
{0,0,-0.9}
{0,0,-0.8}
{0,0,-0.7}
{-1,-1,-1}
{0,0,0}
{0,0,1}
{0,0,0}
{1,-1,-1}
{0,0,0}
{0,0,0}
{0,0,-1}
{0,0,-1}""")
knots_4 = KnotVector(Count="13", Degree=degree_of_curve, Periodic=False)

panel_16 = Panel("""0
1
2
3""")
panel_17 = Panel("""4
5
6
7
8
9
10
11
12""")
cull_i_5 = CullIndex(List=cp_3.Points, Indices=panel_17, Wrap=True)
cull_i_6 = CullIndex(List=cp_3.Points, Indices=panel_16, Wrap=True)
scale_8 = Scale(Geometry=cull_i_5, Center=pt, Factor=plaza_level_2)  # -> Geometry, Transform
panel_18 = Panel([scale_8.Geometry, cull_i_6])

addition_3 = Addition(A=panel_18, B=panel_15)
nurbcrv_4 = NurbsCurve(Points=addition_3, Knots=knots_4)  # -> Curve, Length, Domain

loft_3 = Loft(
    Curves=flatten([nurbcrv_4.Curve, nurbcrv_3.Curve]),
    Options={Adjust=False, Closed=False, LoftEnds=0, LoftSimp=0, LoftType=0, Rebuild=10, Refit=0.01})

multiplication_2 = Multiplication(A=vec, B=3)
move_6 = Move(Geometry=pt, Motion=multiplication_2)  # -> Geometry, Transform
scale_9 = Scale(Geometry=nurbcrv_4.Curve, Center=move_6.Geometry, Factor=level4_scale)  # -> Geometry, Transform
move_7 = Move(Geometry=scale_9.Geometry, Motion=vec)  # -> Geometry, Transform
cp_4 = ControlPoints(Curve=move_7.Geometry)  # -> Points, Weights, Knots
panel_19 = Panel("""{0,0,-1.6}
{0,0,-1.4}
{0,0,-1.3}
{0,0,-1.2}
{-1,-1,-1.1}
{0,0,0}
{0,0,1}
{0,0,0}
{1,-1,-1}
{0,0,0}
{0,0,0}
{0,0,-1}
{0,0,-1}""")
knots_5 = KnotVector(Count="13", Degree=degree_of_curve, Periodic=False)

panel_20 = Panel("""4
5
6
7
8
9
10
11
12""")
panel_21 = Panel("""0
1
2
3""")
cull_i_7 = CullIndex(List=cp_4.Points, Indices=panel_21, Wrap=True)
cull_i_8 = CullIndex(List=cp_4.Points, Indices=panel_20, Wrap=True)
scale_10 = Scale(Geometry=cull_i_8, Center=pt, Factor=plaza_level_3)  # -> Geometry, Transform
panel_22 = Panel([scale_10.Geometry, cull_i_7])

addition_4 = Addition(A=panel_22, B=panel_19)
nurbcrv_5 = NurbsCurve(Points=addition_4, Knots=knots_5)  # -> Curve, Length, Domain

panel_23 = Panel(pt)
pt_2 = Point(panel_23)
scale_11 = Scale(Geometry=nurbcrv_5.Curve, Center=pt_2, Factor=thickness_of_wall)  # -> Geometry, Transform

cp_5 = ControlPoints(Curve=scale_11.Geometry)  # -> Points, Weights, Knots

cull = CullPattern(List=cp_5.Points, CullPattern=[False, False, False, False, True, True, True, True, True, False, False, False, False])
addition_5 = Addition(A=panel_5, B=cull)
pline = PolyLine(Vertices=addition_5, Closed=True)
panel_24 = Panel(addition_5)
wbcatmullclark = WeaverbirdsCatmullClarkSubdivision(MeshCurves=pline, Level="3", SmoothNakedEdges="1")
nv = NakedVertices(Mesh=wbcatmullclark)  # -> Clothed, Naked, ClothedPts, NakedPts

cull_2 = CullPattern(List=cp_5.Points, CullPattern=[False, False, False, False, False, False, False, False, True, True, True, True, True])
addition_6 = Addition(A=panel_6, B=cull_2)
pline_2 = PolyLine(Vertices=addition_6, Closed=True)
panel_25 = Panel(addition_6)
wbcatmullclark_2 = WeaverbirdsCatmullClarkSubdivision(MeshCurves=pline_2, Level="3", SmoothNakedEdges="1")

scale_12 = Scale(Geometry=wbcatmullclark, Center="{0,-19.8,3.2}", Factor=scale)  # -> Geometry, Transform
move_8 = Move(Geometry=scale_12.Geometry, Motion=Z_2)  # -> Geometry, Transform

scale_13 = Scale(Geometry=wbcatmullclark_2, Center="{-6.7336,-40.0636,2.0244}", Factor=scale_2)  # -> Geometry, Transform
move_9 = Move(Geometry=scale_13.Geometry, Motion=Z_3)  # -> Geometry, Transform

mesh = Mesh(move_8.Geometry)
mesh_2 = Mesh(move_9.Geometry)
loft_4 = Loft(
    Curves=flatten([nurbcrv_4.Curve, nurbcrv_5.Curve]),
    Options={Adjust=False, Closed=False, LoftEnds=0, LoftSimp=0, LoftType=0, Rebuild=10, Refit=0.01})
loft_5 = Loft(
    Curves=flatten([scale_11.Geometry, nurbcrv_5.Curve]),
    Options={Adjust=False, Closed=False, LoftEnds=0, LoftSimp=0, LoftType=0, Rebuild=10, Refit=0.01})
brep = Brep([loft, loft_2, loft_3, loft_4, loft_5])
mesh_3 = MeshBrep(
    Brep=brep,
    Settings={GridMaxCount=0, GridMinCount=16, JaggedSeams=False, MaxEdgeLength=0, MinEdgeLength=0.0001, MinTolerance=0, Refine=True, RefineAngle=0, RelativeTolerance=0.65, SimplePlanes=True, Tolerance=0})
brep_2 = Brep([loft_4, loft_3, loft_2, loft])
scale_14 = Scale(Geometry=brep_2, Center=pt, Factor=thickness_of_wall)  # -> Geometry, Transform
capex = CapHolesEx(Brep=[scale_14.Geometry, brep])  # -> Brep, Caps, Solid

# ----
# Generated Dome
# Dome Control Points
number_slider = Slider(2511.255, range=2000..5000)
mesh_4 = Mesh(simplify(flatten([mesh, mesh_2])))
wbvertices = WeaverbirdsVerticesComponent(MeshClosedPolylinesGroup=mesh_4, Weld=True)
wbedges = WeaverbirdsMeshEdges(MeshOrPolylines=mesh_4)
Z_4 = UnitZ(Factor=Slider(110.459, range=-100..200))
uforce = UnaryForce(Point=wbvertices, Force=Z_4)
springs = SpringsFromLine(Connection=wbedges, Stiffness=number_slider, Damping=10, RestLength=wbedges, UpperCutoff=0, LowerCutoff=0, Plasticity=0)
nv_2 = NakedVertices(Mesh=mesh)  # -> ClothedIndex, NakedIndex, ClothedPts, NakedPts
nv_3 = NakedVertices(Mesh=mesh_2)  # -> ClothedIndex, NakedIndex, ClothedPts, NakedPts
demesh = DeconstructMesh(Mesh=mesh)  # -> Vertices, Faces, Colours, Normals
demesh_2 = DeconstructMesh(Mesh=mesh_2)  # -> Vertices, Faces, Colours, Normals
item = ListItem(List=demesh_2.Vertices, Index=nv_3.NakedIndex, Wrap=True)
item_2 = ListItem(List=demesh.Vertices, Index=nv_2.NakedIndex, Wrap=True)
timer = Timer(TimerInterval=20, Target=kangaroo)

panel_26 = Panel(nv_2.ClothedPts)
panel_27 = Panel("""0
1
2
3
4
5
6
7
8
9
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""")
cull_i_9 = CullIndex(List=panel_26, Indices=panel_27, Wrap=False)
panel_28 = Panel(cull_i_9)
pt_3 = Point(panel_28)

kangaroo = KangarooPhysics(
    ForceObjects=flatten([springs, uforce]),
    AnchorPoints=flatten([item, item_2, pt_3]),
    Settings=null,
    Geometry=mesh_4,
    SimulationReset=Toggle(False))  # -> Out, Iterations, ParticlesOut, flatten(GeometryOut), KE

mesh_5 = Mesh(kangaroo.GeometryOut)

# ----
# Convert Mesh to Surface
demesh_3 = DeconstructMesh(Mesh=mesh_5)  # -> Vertices, Faces, Colours, Normals
deface = DeconstructFace(Face=demesh_3.Faces)  # -> CornerA, CornerB, CornerC, CornerD
item_3 = ListItem(List=demesh_3.Vertices, Index=deface.CornerA, Wrap=True)
item_4 = ListItem(List=demesh_3.Vertices, Index=deface.CornerB, Wrap=True)
item_5 = ListItem(List=demesh_3.Vertices, Index=deface.CornerC, Wrap=True)
item_6 = ListItem(List=demesh_3.Vertices, Index=deface.CornerD, Wrap=True)
srf4pt = _4PointSurface(CornerA=item_3, CornerB=item_4, CornerC=item_5, CornerD=item_6)  # -> flatten(Surface)

# ----
# Glass Window
number_slider_2 = Slider(2, range=1..3)
dgrid = DiamondGrid(Surface=srf4pt, UDivisions=number_slider_2, VDivisions=number_slider_2)  # -> CornerPoint1, CornerPoint2, CornerPoint3, CornerPoint4, MidPoint, Normals
pt_4 = Point(<point referenced from the Rhino model>)
weave = Weave(
    Pattern=[0, 1, 2, 3],
    Stream0=graft(dgrid.CornerPoint1),
    Stream1=graft(dgrid.CornerPoint2),
    Stream2=graft(dgrid.CornerPoint3),
    Stream3=graft(dgrid.CornerPoint4),
    NullGaps=False)
dist = Distance(PointA=dgrid.MidPoint, PointB=pt_4)
bnd = Bounds(Numbers=dist)
remap = RemapNumbers(Value=dist, Source=bnd, Target=Domain(0, 1))  # -> Mapped, Clipped
intcrv = Interpolate(Vertices=weave, Degree=expr("1", "1"), Periodic=Toggle(True), KnotStyle=1)  # -> Curve, Length, Domain
multiplication_3 = Multiplication(A=remap.Mapped, B=Slider(0.205, range=0..1))
amp = Amplitude(Vector=dgrid.Normals, Amplitude=multiplication_3)
move_10 = Move(Geometry=dgrid.MidPoint, Motion=amp)  # -> Geometry, Transform
explode = Explode(Curve=intcrv.Curve, Recursive=True)  # -> Segments, Vertices
extr = ExtrudePoint(Base=explode.Segments, Point=graft(move_10.Geometry))  # -> flatten(Extrusion)
mesh_uv = MeshSurface(Surface=extr, UCount=Slider(1, range=0.5..1), VCount=Slider(0.648, range=0.5..1), Overhang=True, Equalize=False)

# ----
# Beam Option1
wbedges_2 = WeaverbirdsMeshEdges(MeshOrPolylines=mesh_5)
Z_5 = UnitZ(Factor=distance_under_glass_window)
pipe = Pipe(Curve=wbedges_2, Radius=pipe_radius, Caps=0)
move_11 = Move(Geometry=pipe, Motion=Z_5)  # -> Geometry, Transform

srf = Surface(srf4pt)

# ----
# Beam Option2
number_slider_3 = Slider(1, range=0..3)
sdivide = DivideSurface(Surface=srf, UCount=number_slider_3, VCount=Slider(2, range=0..3))  # -> Points, Normals, Parameters
flatten = FlattenTree(Tree=sdivide.Points, Path="{0}")
cull_i_10 = CullIndex(List=flatten, Indices="0", Wrap=True)  # -> flatten(List)
panel_29 = Panel(cull_i_10)
panel_30 = Panel(flatten)
panel_31 = Panel([panel_29, "{1.406178, -25.07472, 0.629693}"])
ln = Line(StartPoint=panel_30, EndPoint=panel_31)
cull_i_11 = CullIndex(List=ln, Indices=panel_4, Wrap=True)
pipe_2 = Pipe(Curve=cull_i_11, Radius=pipe_radius, Caps=0)
move_12 = Move(Geometry=pipe_2, Motion=Z_5)  # -> Geometry, Transform

# ----
# Results
mesh_6 = MeshBrep(
    Brep=brep,
    Settings={GridMaxCount=0, GridMinCount=16, JaggedSeams=False, MaxEdgeLength=0, MinEdgeLength=0.0001, MinTolerance=0, Refine=True, RefineAngle=0, RelativeTolerance=0.65, SimplePlanes=True, Tolerance=0})
mesh_7 = Mesh(move_11.Geometry)
mesh_8 = Mesh(move_12.Geometry)
mesh_9 = Mesh(mesh_uv)

# ----
# Analyses1
# Color Coding
# Total
# Areas
# Pipe Length
colour = ColourPicker(PickedColour=RGB(147, 164, 181))
colour_2 = ColourPicker(PickedColour=RGBA(99, 137, 202, 81))
panel_32 = Panel(colour)
panel_33 = Panel(colour_2)
colour_3 = ColourPicker(PickedColour=RGBA(102, 69, 80, 116))
panel_34 = Panel(colour_3)
mcol = MeshColours(Mesh=capex.Brep, Colours=colour)
mcol_2 = MeshColours(Mesh=mesh_7, Colours=colour_3)
mcol_3 = MeshColours(Mesh=mesh_8, Colours=colour_3)
mcol_4 = MeshColours(Mesh=mesh_9, Colours=colour_2)
area = Area(Geometry=mcol_4)  # -> Area, Centroid
area_2 = Area(Geometry=mesh_6)  # -> Area, Centroid
line = Line(wbedges_2)
line_2 = Line(ln)
pipe2_length = Panel(line_2)
pipe1_length = Panel(line)
glass_window_area = Panel(area.Area)
base_structure_area = Panel(area_2.Area)
len = Length(Curve=line_2)
len_2 = Length(Curve=line)
ma = MassAddition(Input=base_structure_area)  # -> Result, PartialResults
ma_2 = MassAddition(Input=len_2)  # -> Result, PartialResults
ma_3 = MassAddition(Input=len)  # -> Result, PartialResults
ma_4 = MassAddition(Input=glass_window_area)  # -> Result, PartialResults
pipe1_total_length = Panel(ma_2.Result)
base_structure_total_area = Panel(ma.Result)
pipe2_total_length = Panel(ma_3.Result)
glass_window_total_area = Panel(ma_4.Result)

# ----
# Analyses 2 Curvature
number_slider_4 = Slider(5, range=1..5)
sdivide_2 = DivideSurface(Surface=srf, UCount=Slider(5, range=1..8), VCount=Slider(5, range=1..8))  # -> Points, Normals, Parameters
sdivide_3 = DivideSurface(Surface=brep, UCount=number_slider_4, VCount=Slider(150, range=1..200))  # -> Points, Normals, Parameters
curvature = SurfaceCurvature(Surface=brep, Point=sdivide_3.Parameters)  # -> Frame, Gaussian, Mean
curvature_2 = SurfaceCurvature(Surface=srf, Point=sdivide_2.Parameters)  # -> Frame, Gaussian, Mean
bnd_2 = Bounds(Numbers=curvature_2.Mean)
bnd_3 = Bounds(Numbers=curvature.Mean)
dedomain = DeconstructDomain(Domain=bnd_2)  # -> Start, End
dedomain_2 = DeconstructDomain(Domain=bnd_3)  # -> Start, End
gradient = Gradient(
    LowerLimit=dedomain_2.Start,
    UpperLimit=dedomain_2.End,
    Parameter=curvature.Mean,
    stops=[0.15: RGB(130, 192, 237), 0.196: RGB(81, 63, 230), 0.611: RGB(82, 3, 16), 0.98: RGB(255, 130, 160)])
gradient_2 = Gradient(
    LowerLimit=dedomain.Start,
    UpperLimit=dedomain.End,
    Parameter=curvature_2.Mean,
    stops=[0: RGB(81, 63, 230), 0: RGB(8, 201, 3), 0: RGB(204, 171, 100), 0: RGB(93, 172, 244), 0: RGB(143, 164, 75), 0: RGB(235, 98, 56), 0: RGB(139, 137, 113), 0: RGB(39, 162, 42), 0: RGB(199, 191, 205), 0: RGB(41, 143, 46)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])
preview = CustomPreview(Geometry=sdivide_2.Points, Shader=gradient_2)
preview_2 = CustomPreview(Geometry=sdivide_3.Points, Shader=gradient)
